# Grasshopper definition Kniteretta_Demonstrator Files.gh (Grasshopper 1.0.7)
# plug-ins: Kniteretta, BitmapPlus

# ----
# Stitch Palette
# R: 66   G: 212   B: 244
# R: 145   G: 30   B:180
# R: 220   G: 190   B: 255
# R: 255   G: 225   B: 25
# R: 0   G: 0   B: 0
# R: 250   G: 190   B: 212
# R: 199   G: 157   B: 165
# R: 67   G: 99   B: 216
# R: 158   G: 91   B: 103
# R: 245   G: 130   B: 49
# R: 90   G: 52   B: 59
# R: 254   G: 244   B: 31
# R: 170   G: 255   B: 195
# R: 177   G: 170   B: 0
# R: 70   G: 153   B: 144
# R: 71   G: 68   B: 0
# R: 128   G: 128   B: 0
# R: 224   G: 5   B: 49
# R: 0   G: 0   B: 117
# R: 174   G: 3   B: 35
# R: 154   G: 99   B: 36
# R: 69   G: 1   B: 14
# R: 255   G: 220   B: 137
# R: 255   G: 188   B: 30
# R: 178   G: 125   B: 0
front = ColourSwatch(SwatchColor=RGB(66, 212, 244))
rear = ColourSwatch(SwatchColor=RGB(255, 225, 25))
both = ColourSwatch(SwatchColor=RGB(250, 190, 212))
tuck_front = ColourSwatch(SwatchColor=RGB(67, 99, 216))
tuck_rear = ColourSwatch(SwatchColor=RGB(245, 130, 49))
knit_front_tuck_rear = ColourSwatch(SwatchColor=RGB(170, 255, 195))
tuck_front_knit_rear = ColourSwatch(SwatchColor=RGB(70, 153, 144))
split_on_rear = ColourSwatch(SwatchColor=RGB(154, 99, 36))
slip = ColourSwatch(SwatchColor=RGB(128, 128, 0))
split_on_front = ColourSwatch(SwatchColor=RGB(0, 0, 117))
transferftor = ColourSwatch(SwatchColor=RGB(145, 30, 180))
transferrtof = ColourSwatch(SwatchColor=RGB(220, 190, 255))
miss = ColourSwatch(SwatchColor=RGB(0, 0, 0))
left_xref_to_rear_1 = ColourSwatch(SwatchColor=RGB(199, 157, 165))
left_xref_to_rear_2 = ColourSwatch(SwatchColor=RGB(158, 91, 103))
left_xref_to_rear_3 = ColourSwatch(SwatchColor=RGB(90, 52, 59))
right_xref_to_rear_1 = ColourSwatch(SwatchColor=RGB(254, 244, 31))
right_xref_to_rear_2 = ColourSwatch(SwatchColor=RGB(177, 170, 0))
right_xref_to_rear_3 = ColourSwatch(SwatchColor=RGB(71, 68, 0))
left_xref_to_front_1 = ColourSwatch(SwatchColor=RGB(224, 5, 49))
left_xref_to_front_2 = ColourSwatch(SwatchColor=RGB(174, 3, 35))
left_xref_to_front_3 = ColourSwatch(SwatchColor=RGB(69, 1, 14))
right_xref_to_front_1 = ColourSwatch(SwatchColor=RGB(255, 220, 137))
right_xref_to_front_2 = ColourSwatch(SwatchColor=RGB(255, 188, 30))
right_xref_to_front_3 = ColourSwatch(SwatchColor=RGB(178, 125, 0))

# ----
# Yarn Palette
# R: 83   G: 77   B: 107
# R: 214   G: 125   B: 83
# R: 124   G: 152   B: 166
# R: 230   G: 189   B: 87
# R: 179   G: 116   B: 134
# R: 4   G: 100   B: 140
# R: 91   G: 152   B: 119
yarn_0 = ColourSwatch(SwatchColor=RGB(83, 77, 107))
yarn_1 = ColourSwatch(SwatchColor=RGB(214, 125, 83))
yarn_2 = ColourSwatch(SwatchColor=RGB(124, 152, 166))
yarn_3 = ColourSwatch(SwatchColor=RGB(230, 189, 87))
yarn_4 = ColourSwatch(SwatchColor=RGB(179, 116, 134))
yarn_5 = ColourSwatch(SwatchColor=RGB(4, 100, 140))
yarn_6 = ColourSwatch(SwatchColor=RGB(91, 152, 119))

# ----
# -Input : Stitch Bitmap
# -Input: Yarn Bitmap
path = FilePath("C:\Mac\Home\Downloads\Kniteretta GH\Knit+Purl_S.bmp")
path_2 = FilePath("C:\Mac\Home\Downloads\Kniteretta GH\Knit+Purl_Y.bmp")

# ----
# Option 1
# Knit + Purl (without transfers)
# Import Bitmap
left_xref_to_rear_3_2 = ColourSwatch(SwatchColor=RGB(90, 52, 59))
left_xref_to_front_3_2 = ColourSwatch(SwatchColor=RGB(69, 1, 14))
left_xref_to_rear_1_2 = ColourSwatch(SwatchColor=RGB(199, 157, 165))
left_xref_to_rear_2_2 = ColourSwatch(SwatchColor=RGB(158, 91, 103))
left_xref_to_front_1_2 = ColourSwatch(SwatchColor=RGB(224, 5, 49))
left_xref_to_front_2_2 = ColourSwatch(SwatchColor=RGB(174, 3, 35))
right_xref_to_front_1_2 = ColourSwatch(SwatchColor=RGB(255, 220, 137))
right_xref_to_front_3_2 = ColourSwatch(SwatchColor=RGB(178, 125, 0))
right_xref_to_front_2_2 = ColourSwatch(SwatchColor=RGB(255, 188, 30))
tuck_front_2 = ColourSwatch(SwatchColor=RGB(67, 99, 216))
tuck_rear_2 = ColourSwatch(SwatchColor=RGB(245, 130, 49))
transferftor_2 = ColourSwatch(SwatchColor=RGB(145, 30, 180))
transferrtof_2 = ColourSwatch(SwatchColor=RGB(220, 190, 255))
right_xref_to_rear_3_2 = ColourSwatch(SwatchColor=RGB(71, 68, 0))
right_xref_to_rear_1_2 = ColourSwatch(SwatchColor=RGB(254, 244, 31))
right_xref_to_rear_2_2 = ColourSwatch(SwatchColor=RGB(177, 170, 0))
loadimg = LoadImage(Path=path)
previmg = PrevImage(SmartBitmap=path)
loadimg_2 = LoadImage(Path=path_2)
previmg_2 = PrevImage(SmartBitmap=path_2)
front_2 = ColourSwatch(SwatchColor=RGB(66, 212, 244))
both_2 = ColourSwatch(SwatchColor=RGB(250, 190, 212))
rear_2 = ColourSwatch(SwatchColor=RGB(255, 225, 25))
tuck_front_knit_rear_2 = ColourSwatch(SwatchColor=RGB(70, 153, 144))
knit_front_tuck_rear_2 = ColourSwatch(SwatchColor=RGB(170, 255, 195))
slip_2 = ColourSwatch(SwatchColor=RGB(128, 128, 0))
miss_2 = ColourSwatch(SwatchColor=RGB(0, 0, 0))
split_on_front_2 = ColourSwatch(SwatchColor=RGB(0, 0, 117))
split_on_rear_2 = ColourSwatch(SwatchColor=RGB(154, 99, 36))
yarn_0_2 = ColourSwatch(SwatchColor=RGB(83, 77, 107))
yarn_1_2 = ColourSwatch(SwatchColor=RGB(214, 125, 83))
yarn_2_2 = ColourSwatch(SwatchColor=RGB(124, 152, 166))
yarn_3_2 = ColourSwatch(SwatchColor=RGB(230, 189, 87))
yarn_4_2 = ColourSwatch(SwatchColor=RGB(179, 116, 134))
yarn_5_2 = ColourSwatch(SwatchColor=RGB(4, 100, 140))
yarn_6_2 = ColourSwatch(SwatchColor=RGB(91, 152, 119))
stitchpalette = CreateStitchPalette(
    Front=front_2,
    Rear=rear_2,
    Both=both_2,
    TuckOnFront=tuck_front_2,
    TuckOnRear=tuck_rear_2,
    KnitFrontTuckRear=knit_front_tuck_rear_2,
    TuckFrontKnitRear=tuck_front_knit_rear_2,
    Slip=slip_2,
    SplitOnFront=split_on_front_2,
    SplitOnRear=split_on_rear_2,
    TransferToRear=transferftor_2,
    TransferToFront=transferrtof_2,
    Miss=miss_2,
    LeftToRear1=left_xref_to_rear_1_2,
    LeftToRear2=left_xref_to_rear_2_2,
    LeftToRear3=left_xref_to_rear_3_2,
    RightToRear1=right_xref_to_rear_1_2,
    RightToRear2=right_xref_to_rear_2_2,
    RightToRear3=right_xref_to_rear_3_2,
    LeftToFront1=left_xref_to_front_1_2,
    LeftToFront2=left_xref_to_front_2_2,
    LeftToFront3=left_xref_to_front_3_2,
    RightToFront1=right_xref_to_front_1_2,
    RightToFront2=right_xref_to_front_2_2,
    RightToFront3=right_xref_to_front_3_2)  # -> Palette, AsList
yarnpalette = CreateYarnPalette(Yarn0=yarn_0_2, Yarn1=yarn_1_2, Yarn2=yarn_2_2, Yarn3=yarn_3_2, Yarn4=yarn_4_2, Yarn5=yarn_5_2, Yarn6=yarn_6_2)  # -> Palette, AsList
setpieceparams = SetPieceParameters(KnitSpeed=Slider(300, range=0..1000), KnitDirection=Slider(2, range=0..10), TransferSpeed=Slider(100, range=0..100))  # -> OutParameters, AsList
genkcode = GenerateKCode(
    Stitches=loadimg,
    Yarn=loadimg_2,
    StitchPalette=stitchpalette.Palette,
    YarnPalette=yarnpalette.Palette,
    CustomParameters=setpieceparams.OutParameters)

# ----
# -Input : Stitch Bitmap
# -Input: Yarn Bitmap
path_3 = FilePath("C:\Mac\Home\Downloads\Kniteretta GH\Eyelet_Y.bmp")
path_4 = FilePath("C:\Mac\Home\Downloads\Kniteretta GH\Eyelet_S.bmp")

# ----
# Components
# Generate
# Inputs
# Parameters
genkcode_2 = GenerateKCode()
transfers = ImplementTransfers()  # -> StitchColours, YarnColours
loadimg_3 = BitmapToColours()
loadimg_4 = LoadImage()
pntstoimg = PointsToImage()
stitchpalette_2 = CreateStitchPalette()  # -> Palette, AsList
yarnpalette_2 = CreateYarnPalette()  # -> Palette, AsList
setpieceparams_2 = SetPieceParameters()  # -> OutParameters, AsList

# ----
# Export K-Code to .txt format and import to Kniterate
# Create a layer "Load txt file pattern"
# Select parameters and add the text file to the "Text file pattern"
# Complete checks and knit!
panel = Panel(genkcode)

# ----
# -Input : Stitch Bitmap
# -Input: Yarn Bitmap
path_5 = FilePath("C:\Mac\Home\Downloads\Kniteretta GH\Eyelet_S.bmp")
path_6 = FilePath("C:\Mac\Home\Downloads\Kniteretta GH\Eyelet_Y.bmp")

# ----
# Option 2
# Eyelets (with transfers)
# Densities (with transfers)
# Import Bitmap
# Transfers
# Import Bitmap
# Transfers
left_xref_to_rear_3_3 = ColourSwatch(SwatchColor=RGB(90, 52, 59))
left_xref_to_front_3_3 = ColourSwatch(SwatchColor=RGB(69, 1, 14))
left_xref_to_rear_1_3 = ColourSwatch(SwatchColor=RGB(199, 157, 165))
left_xref_to_rear_2_3 = ColourSwatch(SwatchColor=RGB(158, 91, 103))
left_xref_to_front_1_3 = ColourSwatch(SwatchColor=RGB(224, 5, 49))
left_xref_to_front_2_3 = ColourSwatch(SwatchColor=RGB(174, 3, 35))
right_xref_to_front_1_3 = ColourSwatch(SwatchColor=RGB(255, 220, 137))
right_xref_to_front_3_3 = ColourSwatch(SwatchColor=RGB(178, 125, 0))
right_xref_to_front_2_3 = ColourSwatch(SwatchColor=RGB(255, 188, 30))
tuck_front_3 = ColourSwatch(SwatchColor=RGB(67, 99, 216))
tuck_rear_3 = ColourSwatch(SwatchColor=RGB(245, 130, 49))
transferftor_3 = ColourSwatch(SwatchColor=RGB(145, 30, 180))
transferrtof_3 = ColourSwatch(SwatchColor=RGB(220, 190, 255))
right_xref_to_rear_3_3 = ColourSwatch(SwatchColor=RGB(71, 68, 0))
right_xref_to_rear_1_3 = ColourSwatch(SwatchColor=RGB(254, 244, 31))
right_xref_to_rear_2_3 = ColourSwatch(SwatchColor=RGB(177, 170, 0))
front_3 = ColourSwatch(SwatchColor=RGB(66, 212, 244))
both_3 = ColourSwatch(SwatchColor=RGB(250, 190, 212))
rear_3 = ColourSwatch(SwatchColor=RGB(255, 225, 25))
tuck_front_knit_rear_3 = ColourSwatch(SwatchColor=RGB(70, 153, 144))
knit_front_tuck_rear_3 = ColourSwatch(SwatchColor=RGB(170, 255, 195))
slip_3 = ColourSwatch(SwatchColor=RGB(128, 128, 0))
miss_3 = ColourSwatch(SwatchColor=RGB(0, 0, 0))
split_on_front_3 = ColourSwatch(SwatchColor=RGB(0, 0, 117))
split_on_rear_3 = ColourSwatch(SwatchColor=RGB(154, 99, 36))
yarn_1_3 = ColourSwatch(SwatchColor=RGB(83, 77, 107))
yarn_1_4 = ColourSwatch(SwatchColor=RGB(214, 125, 83))
yarn_2_3 = ColourSwatch(SwatchColor=RGB(124, 152, 166))
yarn_3_3 = ColourSwatch(SwatchColor=RGB(230, 189, 87))
yarn_4_3 = ColourSwatch(SwatchColor=RGB(179, 116, 134))
yarn_5_3 = ColourSwatch(SwatchColor=RGB(4, 100, 140))
yarn_6_3 = ColourSwatch(SwatchColor=RGB(91, 152, 119))
loadimg_5 = LoadImage(Path=path_4)
previmg_3 = PrevImage(SmartBitmap=path_4)
loadimg_6 = LoadImage(Path=path_3)
previmg_4 = PrevImage(SmartBitmap=path_3)
stitchpalette_3 = CreateStitchPalette(
    Front=front_3,
    Rear=rear_3,
    Both=both_3,
    TuckOnFront=tuck_front_3,
    TuckOnRear=tuck_rear_3,
    KnitFrontTuckRear=knit_front_tuck_rear_3,
    TuckFrontKnitRear=tuck_front_knit_rear_3,
    Slip=slip_3,
    SplitOnFront=split_on_front_3,
    SplitOnRear=split_on_rear_3,
    TransferToRear=transferftor_3,
    TransferToFront=transferrtof_3,
    Miss=miss_3,
    LeftToRear1=left_xref_to_rear_1_3,
    LeftToRear2=left_xref_to_rear_2_3,
    LeftToRear3=left_xref_to_rear_3_3,
    RightToRear1=right_xref_to_rear_1_3,
    RightToRear2=right_xref_to_rear_2_3,
    RightToRear3=right_xref_to_rear_3_3,
    LeftToFront1=left_xref_to_front_1_3,
    LeftToFront2=left_xref_to_front_2_3,
    LeftToFront3=left_xref_to_front_3_3,
    RightToFront1=right_xref_to_front_1_3,
    RightToFront2=right_xref_to_front_2_3,
    RightToFront3=right_xref_to_front_3_3)  # -> Palette, AsList
yarnpalette_3 = CreateYarnPalette(Yarn0=yarn_1_3, Yarn1=yarn_1_4, Yarn2=yarn_2_3, Yarn3=yarn_3_3, Yarn4=yarn_4_3, Yarn5=yarn_5_3, Yarn6=yarn_6_3)  # -> Palette, AsList
transfers_2 = ImplementTransfers(Stitches=loadimg_5, Yarn=loadimg_6, StitchPalette=stitchpalette_3.Palette, YarnPalette=yarnpalette_3.Palette)  # -> StitchColours, YarnColours
setpieceparams_3 = SetPieceParameters(KnitSpeed=Slider(300, range=0..1000), KnitDirection=Slider(2, range=0..10), TransferSpeed=Slider(100, range=0..100))  # -> OutParameters, AsList
genkcode_3 = GenerateKCode(
    Stitches=transfers_2.StitchColours,
    Yarn=transfers_2.YarnColours,
    StitchPalette=stitchpalette_3.Palette,
    YarnPalette=yarnpalette_3.Palette,
    CustomParameters=setpieceparams_3.OutParameters)
left_xref_to_rear_3_4 = ColourSwatch(SwatchColor=RGB(90, 52, 59))
left_xref_to_front_3_4 = ColourSwatch(SwatchColor=RGB(69, 1, 14))
left_xref_to_rear_1_4 = ColourSwatch(SwatchColor=RGB(199, 157, 165))
left_xref_to_rear_2_4 = ColourSwatch(SwatchColor=RGB(158, 91, 103))
left_xref_to_front_1_4 = ColourSwatch(SwatchColor=RGB(224, 5, 49))
left_xref_to_front_2_4 = ColourSwatch(SwatchColor=RGB(174, 3, 35))
right_xref_to_front_1_4 = ColourSwatch(SwatchColor=RGB(255, 220, 137))
right_xref_to_front_3_4 = ColourSwatch(SwatchColor=RGB(178, 125, 0))
right_xref_to_front_2_4 = ColourSwatch(SwatchColor=RGB(255, 188, 30))
tuck_front_4 = ColourSwatch(SwatchColor=RGB(67, 99, 216))
tuck_rear_4 = ColourSwatch(SwatchColor=RGB(245, 130, 49))
transferftor_4 = ColourSwatch(SwatchColor=RGB(145, 30, 180))
transferrtof_4 = ColourSwatch(SwatchColor=RGB(220, 190, 255))
right_xref_to_rear_3_4 = ColourSwatch(SwatchColor=RGB(71, 68, 0))
right_xref_to_rear_1_4 = ColourSwatch(SwatchColor=RGB(254, 244, 31))
right_xref_to_rear_2_4 = ColourSwatch(SwatchColor=RGB(177, 170, 0))
front_4 = ColourSwatch(SwatchColor=RGB(66, 212, 244))
both_4 = ColourSwatch(SwatchColor=RGB(250, 190, 212))
rear_4 = ColourSwatch(SwatchColor=RGB(255, 225, 25))
tuck_front_knit_rear_4 = ColourSwatch(SwatchColor=RGB(70, 153, 144))
knit_front_tuck_rear_4 = ColourSwatch(SwatchColor=RGB(170, 255, 195))
slip_4 = ColourSwatch(SwatchColor=RGB(128, 128, 0))
miss_4 = ColourSwatch(SwatchColor=RGB(0, 0, 0))
split_on_front_4 = ColourSwatch(SwatchColor=RGB(0, 0, 117))
split_on_rear_4 = ColourSwatch(SwatchColor=RGB(154, 99, 36))
yarn_1_5 = ColourSwatch(SwatchColor=RGB(83, 77, 107))
yarn_1_6 = ColourSwatch(SwatchColor=RGB(214, 125, 83))
yarn_2_4 = ColourSwatch(SwatchColor=RGB(124, 152, 166))
yarn_3_4 = ColourSwatch(SwatchColor=RGB(230, 189, 87))
yarn_4_4 = ColourSwatch(SwatchColor=RGB(179, 116, 134))
yarn_5_4 = ColourSwatch(SwatchColor=RGB(4, 100, 140))
yarn_6_4 = ColourSwatch(SwatchColor=RGB(91, 152, 119))
previmg_5 = PrevImage(SmartBitmap=path_5)
loadimg_7 = LoadImage(Path=path_6)
previmg_6 = PrevImage(SmartBitmap=path_6)
loadimg_8 = LoadImage(Path=path_5)
stitchpalette_4 = CreateStitchPalette(
    Front=front_4,
    Rear=rear_4,
    Both=both_4,
    TuckOnFront=tuck_front_4,
    TuckOnRear=tuck_rear_4,
    KnitFrontTuckRear=knit_front_tuck_rear_4,
    TuckFrontKnitRear=tuck_front_knit_rear_4,
    Slip=slip_4,
    SplitOnFront=split_on_front_4,
    SplitOnRear=split_on_rear_4,
    TransferToRear=transferftor_4,
    TransferToFront=transferrtof_4,
    Miss=miss_4,
    LeftToRear1=left_xref_to_rear_1_4,
    LeftToRear2=left_xref_to_rear_2_4,
    LeftToRear3=left_xref_to_rear_3_4,
    RightToRear1=right_xref_to_rear_1_4,
    RightToRear2=right_xref_to_rear_2_4,
    RightToRear3=right_xref_to_rear_3_4,
    LeftToFront1=left_xref_to_front_1_4,
    LeftToFront2=left_xref_to_front_2_4,
    LeftToFront3=left_xref_to_front_3_4,
    RightToFront1=right_xref_to_front_1_4,
    RightToFront2=right_xref_to_front_2_4,
    RightToFront3=right_xref_to_front_3_4)  # -> Palette, AsList
yarnpalette_4 = CreateYarnPalette(Yarn0=yarn_1_5, Yarn1=yarn_1_6, Yarn2=yarn_2_4, Yarn3=yarn_3_4, Yarn4=yarn_4_4, Yarn5=yarn_5_4, Yarn6=yarn_6_4)  # -> Palette, AsList
transfers_3 = ImplementTransfers(Stitches=loadimg_8, Yarn=loadimg_7, StitchPalette=stitchpalette_4.Palette, YarnPalette=yarnpalette_4.Palette)  # -> StitchColours, YarnColours
setpieceparams_4 = SetPieceParameters(KnitSpeed=Slider(300, range=0..1000), KnitDirection=Slider(2, range=0..10), TransferSpeed=Slider(100, range=0..100))  # -> OutParameters, AsList
genkcode_4 = GenerateKCode(
    Stitches=transfers_3.StitchColours,
    Yarn=transfers_3.YarnColours,
    StitchPalette=stitchpalette_4.Palette,
    YarnPalette=yarnpalette_4.Palette,
    CustomParameters=setpieceparams_4.OutParameters)

# ----
# Export K-Code to .txt format and import to Kniterate
# Create a layer "Load txt file pattern"
# Select parameters and add the text file to the "Text file pattern"
# Complete checks and knit!
panel_2 = Panel(genkcode_3)

# ----
# Export K-Code to .txt format and import to Kniterate
# Create a layer "Load txt file pattern"
# Select parameters and add the text file to the "Text file pattern"
# Complete checks and knit!
panel_3 = Panel(genkcode_4)

# ----
# Option 3
# Alternative to generate bitmap
# Import Bitmap
# Transfers
number_slider = Slider(25, range=0..100)
series = Series(Start=0, Step=1, Count=number_slider)
pt = ConstructPoint(XCoordinate=series, YCoordinate=graft(series), ZCoordinate=0)  # -> flatten(Point)
Y = UnitY(Factor=Slider(25, range=0..100))
number_slider_2 = Slider(100, range=0..100)
move = Move(Geometry=pt, Motion=Y)  # -> Geometry, Transform
reduce = RandomReduce(List=pt, Reduction=number_slider_2, Seed=number_slider_2)
reduce_2 = RandomReduce(List=move.Geometry, Reduction=number_slider_2, Seed=number_slider_2)
difference = SetDifference(SetA=pt, SetB=reduce)
difference_2 = SetDifference(SetA=move.Geometry, SetB=reduce_2)
front_5 = ColourSwatch(SwatchColor=RGB(66, 212, 244))
rear_5 = ColourSwatch(SwatchColor=RGB(255, 225, 25))
yarn_1_7 = ColourSwatch(SwatchColor=RGB(214, 125, 83))
yarn_2_5 = ColourSwatch(SwatchColor=RGB(124, 152, 166))
planesrf = PlaneSurface(Plane=difference, XSize="1", YSize="1")
planesrf_2 = PlaneSurface(Plane=reduce_2, XSize="1", YSize="1")
planesrf_3 = PlaneSurface(Plane=difference_2, XSize="1", YSize="1")
planesrf_4 = PlaneSurface(Plane=reduce, XSize="1", YSize="1")
merge = Merge(Data1=yarn_1_7, Data2=yarn_2_5)
entwine = Entwine(Branch00=[reduce, difference_2], Branch01=[reduce_2, difference], FlattenInputs=True)
merge_2 = Merge(Data1=front_5, Data2=rear_5)
preview = CustomPreview(Geometry=planesrf, Material=rear_5)
preview_2 = CustomPreview(Geometry=planesrf_2, Material=rear_5)
preview_3 = CustomPreview(Geometry=planesrf_4, Material=front_5)
preview_4 = CustomPreview(Geometry=planesrf_3, Material=front_5)
pntstoimg_2 = PointsToImage(Points=entwine, Colours=merge_2)
pntstoimg_3 = PointsToImage(Points=entwine, Colours=merge)
resizeimg = ResizeImage(Image=pntstoimg_2, Mode=2, Width="100", Height="200")
resizeimg_2 = ResizeImage(Image=pntstoimg_3, Mode=2, Width="100", Height="200")
previmg_7 = PrevImage(SmartBitmap=resizeimg)
previmg_8 = PrevImage(SmartBitmap=resizeimg_2)
left_xref_to_rear_1_5 = ColourSwatch(SwatchColor=RGB(199, 157, 165))
left_xref_to_rear_3_5 = ColourSwatch(SwatchColor=RGB(90, 52, 59))
left_xref_to_front_1_5 = ColourSwatch(SwatchColor=RGB(224, 5, 49))
left_xref_to_front_3_5 = ColourSwatch(SwatchColor=RGB(69, 1, 14))
left_xref_to_rear_2_5 = ColourSwatch(SwatchColor=RGB(158, 91, 103))
left_xref_to_front_2_5 = ColourSwatch(SwatchColor=RGB(174, 3, 35))
right_xref_to_front_3_5 = ColourSwatch(SwatchColor=RGB(178, 125, 0))
right_xref_to_front_1_5 = ColourSwatch(SwatchColor=RGB(255, 220, 137))
right_xref_to_front_2_5 = ColourSwatch(SwatchColor=RGB(255, 188, 30))
tuck_front_5 = ColourSwatch(SwatchColor=RGB(67, 99, 216))
tuck_rear_5 = ColourSwatch(SwatchColor=RGB(245, 130, 49))
transferftor_5 = ColourSwatch(SwatchColor=RGB(145, 30, 180))
transferrtof_5 = ColourSwatch(SwatchColor=RGB(220, 190, 255))
right_xref_to_rear_3_5 = ColourSwatch(SwatchColor=RGB(71, 68, 0))
right_xref_to_rear_1_5 = ColourSwatch(SwatchColor=RGB(254, 244, 31))
right_xref_to_rear_2_5 = ColourSwatch(SwatchColor=RGB(177, 170, 0))
both_5 = ColourSwatch(SwatchColor=RGB(250, 190, 212))
front_6 = ColourSwatch(SwatchColor=RGB(66, 212, 244))
rear_6 = ColourSwatch(SwatchColor=RGB(255, 225, 25))
tuck_front_knit_rear_5 = ColourSwatch(SwatchColor=RGB(70, 153, 144))
knit_front_tuck_rear_5 = ColourSwatch(SwatchColor=RGB(170, 255, 195))
slip_5 = ColourSwatch(SwatchColor=RGB(128, 128, 0))
miss_5 = ColourSwatch(SwatchColor=RGB(0, 0, 0))
split_on_front_5 = ColourSwatch(SwatchColor=RGB(0, 0, 117))
split_on_rear_5 = ColourSwatch(SwatchColor=RGB(154, 99, 36))
yarn_0_3 = ColourSwatch(SwatchColor=RGB(83, 77, 107))
yarn_1_8 = ColourSwatch(SwatchColor=RGB(214, 125, 83))
yarn_3_5 = ColourSwatch(SwatchColor=RGB(230, 189, 87))
yarn_4_5 = ColourSwatch(SwatchColor=RGB(179, 116, 134))
yarn_2_6 = ColourSwatch(SwatchColor=RGB(124, 152, 166))
yarn_5_5 = ColourSwatch(SwatchColor=RGB(4, 100, 140))
yarn_6_5 = ColourSwatch(SwatchColor=RGB(91, 152, 119))
stitchpalette_5 = CreateStitchPalette(
    Front=front_6,
    Rear=rear_6,
    Both=both_5,
    TuckOnFront=tuck_front_5,
    TuckOnRear=tuck_rear_5,
    KnitFrontTuckRear=knit_front_tuck_rear_5,
    TuckFrontKnitRear=tuck_front_knit_rear_5,
    Slip=slip_5,
    SplitOnFront=split_on_front_5,
    SplitOnRear=split_on_rear_5,
    TransferToRear=transferftor_5,
    TransferToFront=transferrtof_5,
    Miss=miss_5,
    LeftToRear1=left_xref_to_rear_1_5,
    LeftToRear2=left_xref_to_rear_2_5,
    LeftToRear3=left_xref_to_rear_3_5,
    RightToRear1=right_xref_to_rear_1_5,
    RightToRear2=right_xref_to_rear_2_5,
    RightToRear3=right_xref_to_rear_3_5,
    LeftToFront1=left_xref_to_front_1_5,
    LeftToFront2=left_xref_to_front_2_5,
    LeftToFront3=left_xref_to_front_3_5,
    RightToFront1=right_xref_to_front_1_5,
    RightToFront2=right_xref_to_front_2_5,
    RightToFront3=right_xref_to_front_3_5)  # -> Palette, AsList
yarnpalette_5 = CreateYarnPalette(Yarn0=yarn_0_3, Yarn1=yarn_1_8, Yarn2=yarn_2_6, Yarn3=yarn_3_5, Yarn4=yarn_4_5, Yarn5=yarn_5_5, Yarn6=yarn_6_5)  # -> Palette, AsList
setpieceparams_5 = SetPieceParameters(KnitSpeed=Slider(300, range=0..1000), KnitDirection=Slider(2, range=0..10), TransferSpeed=Slider(100, range=0..100))  # -> OutParameters, AsList

# ----
# -Input : Stitch Bitmap
# -Input: Yarn Bitmap
loadimg_9 = BitmapToColours(Bitmap=pntstoimg_2)
loadimg_10 = BitmapToColours(Bitmap=pntstoimg_3)

panel_4 = Panel(loadimg_10)
panel_5 = Panel(loadimg_9)
transfers_4 = ImplementTransfers(Stitches=loadimg_9, Yarn=loadimg_10, StitchPalette=stitchpalette_5.Palette, YarnPalette=yarnpalette_5.Palette)  # -> StitchColours, YarnColours
genkcode_5 = GenerateKCode(
    Stitches=transfers_4.StitchColours,
    Yarn=transfers_4.YarnColours,
    StitchPalette=stitchpalette_5.Palette,
    YarnPalette=yarnpalette_5.Palette,
    CustomParameters=setpieceparams_5.OutParameters)

# ----
# Export K-Code to .txt format and import to Kniterate
# Create a layer "Load txt file pattern"
# Select parameters and add the text file to the "Text file pattern"
# Complete checks and knit!
panel_6 = Panel(genkcode_5)
