# Grasshopper definition Kniteretta_Demonstrator.gh (Grasshopper 1.0.7)
# plug-ins: Kniteretta

# ---- group: Basic Bitmap - Text Export
# -Input : Stitch Bitmap
# -Input: Yarn Bitmap
path = FilePath("C:\files\repositories\Personal\Kniteretta\release\Bitmap samples\Simple Image Example\Stitch.bmp")
path_2 = FilePath("C:\files\repositories\Personal\Kniteretta\release\Bitmap samples\Simple Image Example\Yarn.bmp")
left_xref_to_rear_3 = ColourSwatch(SwatchColor=RGB(90, 52, 59))
left_xref_to_front_3 = ColourSwatch(SwatchColor=RGB(69, 1, 14))
left_xref_to_rear_1 = ColourSwatch(SwatchColor=RGB(199, 157, 165))
left_xref_to_rear_2 = ColourSwatch(SwatchColor=RGB(158, 91, 103))
left_xref_to_front_1 = ColourSwatch(SwatchColor=RGB(224, 5, 49))
left_xref_to_front_2 = ColourSwatch(SwatchColor=RGB(174, 3, 35))
loadimg = LoadImage(Path=path)
loadimg_2 = LoadImage(Path=path_2)
right_xref_to_front_3 = ColourSwatch(SwatchColor=RGB(178, 125, 0))
right_xref_to_front_1 = ColourSwatch(SwatchColor=RGB(255, 220, 137))
right_xref_to_front_2 = ColourSwatch(SwatchColor=RGB(255, 188, 30))
tuck_front = ColourSwatch(SwatchColor=RGB(67, 99, 216))
tuck_rear = ColourSwatch(SwatchColor=RGB(245, 130, 49))
transferftor = ColourSwatch(SwatchColor=RGB(145, 30, 180))
transferrtof = ColourSwatch(SwatchColor=RGB(220, 190, 255))
right_xref_to_rear_1 = ColourSwatch(SwatchColor=RGB(254, 244, 31))
right_xref_to_rear_3 = ColourSwatch(SwatchColor=RGB(71, 68, 0))
right_xref_to_rear_2 = ColourSwatch(SwatchColor=RGB(177, 170, 0))
front = ColourSwatch(SwatchColor=RGB(66, 212, 244))
rear = ColourSwatch(SwatchColor=RGB(255, 225, 25))
both = ColourSwatch(SwatchColor=RGB(250, 190, 212))
tuck_front_knit_rear = ColourSwatch(SwatchColor=RGB(70, 153, 144))
knit_front_tuck_rear = ColourSwatch(SwatchColor=RGB(170, 255, 195))
slip = ColourSwatch(SwatchColor=RGB(128, 128, 0))
miss = ColourSwatch(SwatchColor=RGB(0, 0, 0))
split_on_front = ColourSwatch(SwatchColor=RGB(0, 0, 117))
split_on_rear = ColourSwatch(SwatchColor=RGB(154, 99, 36))
yarn_1 = ColourSwatch(SwatchColor=RGB(83, 77, 107))
yarn_1_2 = ColourSwatch(SwatchColor=RGB(214, 125, 83))
yarn_2 = ColourSwatch(SwatchColor=RGB(124, 152, 166))
yarn_3 = ColourSwatch(SwatchColor=RGB(230, 189, 87))
yarn_4 = ColourSwatch(SwatchColor=RGB(179, 116, 134))
yarn_5 = ColourSwatch(SwatchColor=RGB(4, 100, 140))
yarn_6 = ColourSwatch(SwatchColor=RGB(91, 152, 119))
stitchpalette = CreateStitchPalette(
    Front=front,
    Rear=rear,
    Both=both,
    TuckOnFront=tuck_front,
    TuckOnRear=tuck_rear,
    KnitFrontTuckRear=knit_front_tuck_rear,
    TuckFrontKnitRear=tuck_front_knit_rear,
    Slip=slip,
    SplitOnFront=split_on_front,
    SplitOnRear=split_on_rear,
    TransferToRear=transferftor,
    TransferToFront=transferrtof,
    Miss=miss,
    LeftToRear1=left_xref_to_rear_1,
    LeftToRear2=left_xref_to_rear_2,
    LeftToRear3=left_xref_to_rear_3,
    RightToRear1=right_xref_to_rear_1,
    RightToRear2=right_xref_to_rear_2,
    RightToRear3=right_xref_to_rear_3,
    LeftToFront1=left_xref_to_front_1,
    LeftToFront2=left_xref_to_front_2,
    LeftToFront3=left_xref_to_front_3,
    RightToFront1=right_xref_to_front_1,
    RightToFront2=right_xref_to_front_2,
    RightToFront3=right_xref_to_front_3)  # -> Palette, AsList
yarnpalette = CreateYarnPalette(Yarn0=yarn_1, Yarn1=yarn_1_2, Yarn2=yarn_2, Yarn3=yarn_3, Yarn4=yarn_4, Yarn5=yarn_5, Yarn6=yarn_6)  # -> Palette, AsList
setpieceparams = SetPieceParameters(KnitSpeed=Slider(300, range=0..1000), KnitDirection=Slider(2, range=0..10), TransferSpeed=Slider(100, range=0..100))  # -> OutParameters, AsList
genkcode = GenerateKCode(
    Stitches=loadimg,
    Yarn=loadimg_2,
    StitchPalette=stitchpalette.Palette,
    YarnPalette=yarnpalette.Palette,
    CustomParameters=setpieceparams.OutParameters)
panel = Panel(genkcode)

# ---- group: Example with Automatic Transferes
left_xref_to_rear_3_2 = ColourSwatch(SwatchColor=RGB(90, 52, 59))
left_xref_to_front_1_2 = ColourSwatch(SwatchColor=RGB(224, 5, 49))
left_xref_to_front_3_2 = ColourSwatch(SwatchColor=RGB(69, 1, 14))
left_xref_to_rear_1_2 = ColourSwatch(SwatchColor=RGB(199, 157, 165))
left_xref_to_rear_2_2 = ColourSwatch(SwatchColor=RGB(158, 91, 103))
left_xref_to_front_2_2 = ColourSwatch(SwatchColor=RGB(174, 3, 35))
right_xref_to_front_3_2 = ColourSwatch(SwatchColor=RGB(178, 125, 0))
right_xref_to_front_1_2 = ColourSwatch(SwatchColor=RGB(255, 220, 137))
right_xref_to_front_2_2 = ColourSwatch(SwatchColor=RGB(255, 188, 30))
tuck_front_2 = ColourSwatch(SwatchColor=RGB(67, 99, 216))
tuck_rear_2 = ColourSwatch(SwatchColor=RGB(245, 130, 49))
transferftor_2 = ColourSwatch(SwatchColor=RGB(145, 30, 180))
transferrtof_2 = ColourSwatch(SwatchColor=RGB(220, 190, 255))
right_xref_to_rear_3_2 = ColourSwatch(SwatchColor=RGB(71, 68, 0))
right_xref_to_rear_1_2 = ColourSwatch(SwatchColor=RGB(254, 244, 31))
right_xref_to_rear_2_2 = ColourSwatch(SwatchColor=RGB(177, 170, 0))
both_2 = ColourSwatch(SwatchColor=RGB(250, 190, 212))
front_2 = ColourSwatch(SwatchColor=RGB(66, 212, 244))
rear_2 = ColourSwatch(SwatchColor=RGB(255, 225, 25))
tuck_front_knit_rear_2 = ColourSwatch(SwatchColor=RGB(70, 153, 144))
knit_front_tuck_rear_2 = ColourSwatch(SwatchColor=RGB(170, 255, 195))
slip_2 = ColourSwatch(SwatchColor=RGB(128, 128, 0))
miss_2 = ColourSwatch(SwatchColor=RGB(0, 0, 0))
split_on_front_2 = ColourSwatch(SwatchColor=RGB(0, 0, 117))
split_on_rear_2 = ColourSwatch(SwatchColor=RGB(154, 99, 36))
# -Input: Yarn Bitmap
path_3 = FilePath("C:\files\repositories\Personal\Kniteretta\release\Bitmap samples\Transferes Image Example\Large Densities_Knit 1 Miss 1_60x80_Y.bmp")
# -Input : Stitch Bitmap
path_4 = FilePath("C:\files\repositories\Personal\Kniteretta\release\Bitmap samples\Transferes Image Example\Large Densities_Knit 1 Miss 1_60x80_S.bmp")
yarn_1_3 = ColourSwatch(SwatchColor=RGB(83, 77, 107))
yarn_1_4 = ColourSwatch(SwatchColor=RGB(214, 125, 83))
yarn_2_2 = ColourSwatch(SwatchColor=RGB(124, 152, 166))
yarn_3_2 = ColourSwatch(SwatchColor=RGB(230, 189, 87))
yarn_4_2 = ColourSwatch(SwatchColor=RGB(179, 116, 134))
yarn_5_2 = ColourSwatch(SwatchColor=RGB(4, 100, 140))
yarn_6_2 = ColourSwatch(SwatchColor=RGB(91, 152, 119))
loadimg_3 = LoadImage(Path=path_3)
stitchpalette_2 = CreateStitchPalette(
    Front=front_2,
    Rear=rear_2,
    Both=both_2,
    TuckOnFront=tuck_front_2,
    TuckOnRear=tuck_rear_2,
    KnitFrontTuckRear=knit_front_tuck_rear_2,
    TuckFrontKnitRear=tuck_front_knit_rear_2,
    Slip=slip_2,
    SplitOnFront=split_on_front_2,
    SplitOnRear=split_on_rear_2,
    TransferToRear=transferftor_2,
    TransferToFront=transferrtof_2,
    Miss=miss_2,
    LeftToRear1=left_xref_to_rear_1_2,
    LeftToRear2=left_xref_to_rear_2_2,
    LeftToRear3=left_xref_to_rear_3_2,
    RightToRear1=right_xref_to_rear_1_2,
    RightToRear2=right_xref_to_rear_2_2,
    RightToRear3=right_xref_to_rear_3_2,
    LeftToFront1=left_xref_to_front_1_2,
    LeftToFront2=left_xref_to_front_2_2,
    LeftToFront3=left_xref_to_front_3_2,
    RightToFront1=right_xref_to_front_1_2,
    RightToFront2=right_xref_to_front_2_2,
    RightToFront3=right_xref_to_front_3_2)  # -> Palette, AsList
yarnpalette_2 = CreateYarnPalette(Yarn0=yarn_1_3, Yarn1=yarn_1_4, Yarn2=yarn_2_2, Yarn3=yarn_3_2, Yarn4=yarn_4_2, Yarn5=yarn_5_2, Yarn6=yarn_6_2)  # -> Palette, AsList
loadimg_4 = LoadImage(Path=path_4)
transfers = ImplementTransfers(Stitches=loadimg_4, Yarn=loadimg_3, StitchPalette=stitchpalette_2.Palette, YarnPalette=yarnpalette_2.Palette)  # -> StitchColours, YarnColours
setpieceparams_2 = SetPieceParameters(KnitSpeed=Slider(300, range=0..1000), KnitDirection=Slider(2, range=0..10), TransferSpeed=Slider(100, range=0..100))  # -> OutParameters, AsList
genkcode_2 = GenerateKCode(
    Stitches=transfers.StitchColours,
    Yarn=transfers.YarnColours,
    StitchPalette=stitchpalette_2.Palette,
    YarnPalette=yarnpalette_2.Palette,
    CustomParameters=setpieceparams_2.OutParameters)
panel_2 = Panel(genkcode_2)
