# Grasshopper definition Kniteretta_Generate image.gh (Grasshopper 1.0.7)
# plug-ins: Kniteretta, BitmapPlus

series = Series(Start=0, Step=1, Count=10)
pt = ConstructPoint(XCoordinate=series, YCoordinate=graft(series), ZCoordinate=0)  # -> flatten(Point)
Y = UnitY(Factor="10")
number_slider = Slider(54, range=0..100)
move = Move(Geometry=pt, Motion=Y)  # -> Geometry, Transform
reduce = RandomReduce(List=pt, Reduction=number_slider, Seed=number_slider)
reduce_2 = RandomReduce(List=move.Geometry, Reduction=number_slider, Seed=number_slider)
swatch = ColourSwatch(SwatchColor=RGB(255, 0, 0))
swatch_2 = ColourSwatch(SwatchColor=RGB(128, 255, 0))
entwine = Entwine(Branch00=reduce, Branch01=reduce_2, FlattenInputs=True)
planesrf = PlaneSurface(Plane=reduce_2, XSize="1", YSize="1")
planesrf_2 = PlaneSurface(Plane=reduce, XSize="1", YSize="1")
merge = Merge(Data1=swatch, Data2=swatch_2)
preview = CustomPreview(Geometry=planesrf, Material=swatch_2)
preview_2 = CustomPreview(Geometry=planesrf_2, Material=swatch)
pntstoimg = PointsToImage(Points=entwine, Colours=merge)
loadimg = BitmapToColours(Bitmap=pntstoimg)
resizeimg = ResizeImage(Image=pntstoimg, Mode=2, Width="100", Height="200")
previmg = PrevImage(SmartBitmap=resizeimg)
panel = Panel(loadimg)
